# Requirement set Req_pet_integration (R2024a)

## 1 [#1] Overview (Informational)
This document outlines the requirements for the development of PET integration functions for the Brainstorm neuroimaging software. This module will support importing, processing, visualizing, and analyzing multimodal datasets including MRI, MEG, and PET. It will be designed to facilitate user interaction with longitudinal, multimodal neuroimaging data, particularly in the context of Alzheimer's disease (AD) research.

## 2 [#3] Functional Requirements (Container)

### 2.1 [#4] Overview (Informational)

### 2.2 [#5] User interface (Container)

#### 2.2.1 [#6] Layout and navigation

#### 2.2.2 [#7] Feedback and notifications
The GUI will provide feedback for each action (e.g., “Dataset successfully imported,” “PET overlay applied”).
A progress bar will be displayed during longer processing tasks, such as PVC.

### 2.3 [#8] IO - Import PET (Container)

### 2.4 [#9] Overview (Informational)
We need a function for importing PET volumes, similar to import_mri

### 2.5 [#10] Processing - PET (Container)

#### 2.5.1 [#11] Co-registration

#### 2.5.2 [#12] SUVR Calculation

#### 2.5.3 [#13] Partial Volume Correction

### 2.6 [#14] Visualization (Container)

#### 2.6.1 [#15] Overview (Informational)

## 3 [#16] Non-functional Requirements (Container)

### 3.1 [#17] Overview (Informational)

### 3.2 [#18] Error handling (Informational)
Error handling will be implemented to guide users in case of incorrect inputs or processing failures.

### 3.3 [#19] Contextual tool tips (Informational)
Contextual tooltips will be provided to explain the use of each feature.

### 3.4 [#20] Compatibility (Informational)
The GUI must be fully compatible with the existing Brainstorm software architecture and avoid changes to the core code base.
The extension will support all major operating systems that Brainstorm supports (Windows, macOS, Linux).

### 3.5 [#21] Open-source (Informational)
The GUI must avoid toolboxes that are not part of the core MATLAB toolboxes used in Brainstorm
Recent MATLAB functions that have been distributed in the past 10 must be avoided.

### 3.6 [#22] Intuitive interface (Informational)
The added interfaces will be intuitive, with easy navigation and similarity to existing Brainstorm workflows that handle volumes.
Keywords: Intuitive

### 3.7 [#23] Performance (Informational)
The GUI should handle datasets of varying sizes, from small single-session studies to large longitudinal datasets, without significant lag.
Data processing tasks such as MRI-PET registration and PVC should execute efficiently, leveraging multicore processing where available.

#### 3.7.1 [#24] Memory and processing constraints
- The GUI must not introduce performance bottlenecks or interfere with the existing functionalities of Brainstorm.
- The GUI must operate within the memory and processing constraints of common research workstations.

### 3.8 [#25] Maintainability (Informational)
The code should follow Brainstorm’s development standards and be well-documented to allow for easy maintenance and updates.

## 4 [#26] Test Requirements (Container)
These the test requirements derived from the functional requirements.

### 4.1 [#27] Overview (Informational)

### 4.2 [#28] Test Cases (Container)

#### 4.2.1 [#29] Nominal Mode Tests (Container)

#### 4.2.2 [#30] Tests for invalid conditions